# Grasshopper definition Building_Karamba3d_v2.gh (Grasshopper 1.0.7)
# plug-ins: Karamba3D

colour_swatch = ColourSwatch(SwatchColor=RGB(255, 10, 10))

expression = Expression(E="20000", v="0.30", Expression="E / ( 2 * (1 + v) )")
panel = Panel("G = E/ 2(1+v)")
material_properties_karamba3d = MaterialPropertiesKaramba3D(
    FamilyOfMaterial="Steel",
    Name="S235_type1",
    Color=colour_swatch,
    YoungsModulus_kN_cm2="20000",
    InPlaneShearModulus_kN_cm2=expression,
    TransverseShearModulus_kN_cm2=expression,
    SpecificWeight_kN_m3=78.5,
    CoefficientOfThermalExpansion_1_C=1.2e-05,
    TensileStrength_kN_cm2=23.5,
    CompressiveStrength_kN_cm2=-23.5,
    StrengthHypothesis="MISES",
    mode="Isotrop")

panel_2 = Panel("Unità in metri")
cross_section_range_selector_karamba3d = CrossSectionRangeSelectorKaramba3D(MaximumHeight_cm=-1, MaximumWidth_cm=-1, Color=colour_swatch, menu=[dropdown(1), dropdown(1), dropdown(0)])

cross_section_selector_karamba3d = CrossSectionSelectorKaramba3D(
    CrossSections=cross_section_range_selector_karamba3d,
    NameOrListIndexOfCrossSection="hea 200",
    Material=material_properties_karamba3d)  # -> CrossSection, Info

colour_swatch_2 = ColourSwatch(SwatchColor=RGB(255, 255, 255))

# ----
# Wall
material_selection_karamba3d = MaterialSelectionKaramba3D(menu=[dropdown(7), dropdown(6)])
surface = Surface([<surface referenced from the Rhino model> x6])
cross_section_karamba3d = CrossSectionKaramba3D(FamilyNameOfCrossSection="DefaultCroSec", Material=material_selection_karamba3d, Height_cm="30", mode="Shell - Const")
mesh_surface = MeshSurface(Surface=surface, UCount=5, VCount=5, Overhang=True, Equalize=False)
mesh_to_shell_karamba3d = MeshToShellKaramba3D(Mesh=mesh_surface, CrossSection=cross_section_karamba3d, LimitDistance_m=0.005)  # -> Element, Points, Info

# ----
# Slab
material_selection_karamba3d_2 = MaterialSelectionKaramba3D(Color=colour_swatch_2, menu=[dropdown(7), dropdown(6)])
surface_2 = Surface([<surface referenced from the Rhino model> x14])
cross_section_karamba3d_2 = CrossSectionKaramba3D(FamilyNameOfCrossSection="DefaultCroSec", Material=material_selection_karamba3d_2, Height_cm="30", mode="Shell - Const")
mesh_surface_2 = MeshSurface(Surface=surface_2, UCount=5, VCount=5, Overhang=True, Equalize=False)
mesh_to_shell_karamba3d_2 = MeshToShellKaramba3D(Mesh=mesh_surface_2, CrossSection=cross_section_karamba3d_2, LimitDistance_m=0.005)  # -> Element, Points, Info

_1_mm = Panel("0.001")
panel_3 = Panel("2")  # "kN/ml"
unit_z = UnitZ(Factor=1)
unit_z_2 = UnitZ(Factor=1)
mesh = Mesh(mesh_surface_2)
negative = Negative(Value="4")
unit_z_3 = UnitZ(Factor=negative)
loads_karamba3d = LoadsKaramba3D(Vector=Vector(0, 0, -1), LCase="0", mode="Gravity")
panel_4 = Panel(loads_karamba3d)
loads_karamba3d_2 = LoadsKaramba3D(Vector=unit_z_3, Mesh=mesh, LCase="3", mode="MeshLoad -Const.", menu=[buttons(off, on, off), buttons(on, on)])
panel_5 = Panel("&Colonne")

# ----
# Colonne
curve = Curve([<curve referenced from the Rhino model> x39])

list_length = ListLength(List=curve)
series = Series(Start=0, Step=1, Count=list_length)
curve_2 = Curve(curve)
concatenate = Concatenate(FragmentA="Colonne", FragmentB=series)
length = Length(Curve=curve_2)

curve_3 = Curve(curve)
panel_6 = Panel("2")  # "kN/ml"
length_2 = Length(Curve=curve_3)
multiplication = Multiplication(A=length_2, B=panel_6)
division = Division(A=multiplication, B="2")
end_points = EndPoints(Curve=curve_3)  # -> Start, End
unit_x = UnitX(Factor=division)
entwine = Entwine(Branch00=end_points.Start, Branch01=end_points.End, FlattenInputs=True)
loads_karamba3d_3 = LoadsKaramba3D(ForceVector=unit_x, Local=False, PosInd=entwine, LCase="1", mode="Point")

multiplication_2 = Multiplication(A=length, B=panel_3)

line_to_beam_karamba3d = LineToBeamKaramba3D(
    Line=curve,
    Identifier=concatenate,
    CrossSection=cross_section_selector_karamba3d.CrossSection,
    New=True,
    Remove=True,
    LimitDistance_m=0.005,
    Bending=True,
    SetBucklingLength=True,
    ToPolylineMaxAngle=0.03,
    ToPolylineTolerance=0.01,
    ToPolylineMaxEdgeLength=0.25)  # -> Element, Points, Info

element_karamba3d = ElementKaramba3D(line_to_beam_karamba3d.Element)
disassemble_element_karamba3d = DisassembleElementKaramba3D(Element=element_karamba3d)  # -> Element, ElementIdentifier, AxisOfElement, CrossSection, Joint, Material, LocalCoordinateSystem, ElementIsActive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
division_2 = Division(A=multiplication_2, B="2")
end_points_2 = EndPoints(Curve=curve_2)  # -> Start, End
curve_4 = Curve(disassemble_element_karamba3d.AxisOfElement)
unit_x_2 = UnitX(Factor=division_2)
disassemble_element_karamba3d_2 = DisassembleElementKaramba3D(Element=line_to_beam_karamba3d.Element)  # -> Element, ElementIdentifier, AxisOfElement, CrossSection, Joint, Material, LocalCoordinateSystem, ElementIsActive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
end_points_3 = EndPoints(Curve=curve_4)  # -> Start, End
perp_frame = PerpFrame(Curve=reparameterize(curve_4), Parameter="0.50")
deconstruct = Deconstruct(Point=end_points_3.End)  # -> XComponent, YComponent, ZComponent
evaluate = Evaluate(Expression="x^2", x=deconstruct.ZComponent)
list_item = ListItem(List=disassemble_element_karamba3d_2.ElementIdentifier, Index="31", Wrap=True)
deconstruct_plane = DeconstructPlane(Plane=perp_frame)  # -> Origin, XAxis, YAxis, ZAxis
loads_karamba3d_4 = LoadsKaramba3D(ForceVector=unit_x_2, Local=False, PosInd=end_points_2.End, LCase="1", mode="Point")
loads_karamba3d_5 = LoadsKaramba3D(ForceVector=unit_x_2, Local=False, PosInd=end_points_2.Start, LCase="1", mode="Point")
beam_joints_karamba3d = BeamJointsKaramba3D(
    AtElementIdentifiers=list_item,
    CtKNMAtStartingNode=Vector(0, 0, 0),
    CrKNmRadAtStartingNode=Vector(0, 0, 0),
    CtKNMAtEndNode=Vector(0, 0, 0),
    CrKNmRadAtEndNode=Vector(0, 0, 0),
    menu=[buttons(off, off, off, off, off, on), buttons(off, off, off, off, off, off)])
multiplication_3 = Multiplication(A=deconstruct_plane.XAxis, B=evaluate)
beam_loads_karamba3d = BeamLoadsKaramba3D(
    BeamIdentifier=element_karamba3d,
    LoadCase="4",
    ForceVector=multiplication_3,
    TStart=0,
    TEnd=1,
    mode="Block",
    menu=[buttons(off, on, off)])
joint_karamba3d = JointKaramba3D(beam_joints_karamba3d)

material_selection_karamba3d_3 = MaterialSelectionKaramba3D(Color=colour_swatch_2, menu=[dropdown(7), dropdown(6)])
curve_5 = Curve([<curve referenced from the Rhino model> x47])
panel_7 = Panel("Digit \"Scribble\" on canvas")

concatenate_2 = Concatenate(Fragment_A="30", Fragment_B="x", A="60")

cross_section_karamba3d_3 = CrossSectionKaramba3D(
    FamilyNameOfCrossSection="DefaultCroSec",
    NameOfCrossSection=concatenate_2,
    Material=material_selection_karamba3d_3,
    Height_cm="60",
    UpperFlangeWidth_cm="30",
    LowerFlangeWidth_cm="30",
    mode="Trapezoid")
line_to_beam_karamba3d_2 = LineToBeamKaramba3D(
    Line=curve_5,
    CrossSection=cross_section_karamba3d_3,
    New=True,
    Remove=True,
    LimitDistance_m=0.005,
    Bending=True,
    SetBucklingLength=True,
    ToPolylineMaxAngle=0.03,
    ToPolylineTolerance=0.01,
    ToPolylineMaxEdgeLength=0.25)  # -> Element, Points, Info

point = Point(flatten([line_to_beam_karamba3d.Points, line_to_beam_karamba3d_2.Points, mesh_to_shell_karamba3d_2.Points, mesh_to_shell_karamba3d.Points]))
deconstruct_2 = Deconstruct(Point=point)  # -> XComponent, YComponent, ZComponent
bounds = Bounds(Numbers=deconstruct_2.ZComponent)
deconstruct_domain = DeconstructDomain(Domain=bounds)  # -> Start, End
addition = Addition(A=deconstruct_domain.Start, B=_1_mm)
smaller_than = SmallerThan(FirstNumber=deconstruct_2.ZComponent, SecondNumber=addition)  # -> SmallerThan, OrEqualTo
element_karamba3d_2 = ElementKaramba3D(line_to_beam_karamba3d_2.Element)
cull_pattern = CullPattern(List=point, CullPattern=smaller_than.SmallerThan)
element_karamba3d_3 = ElementKaramba3D(line_to_beam_karamba3d_2.Element)
remove_duplicate_points_karamba3d = RemoveDuplicatePointsKaramba3D(Point=cull_pattern, LimitDistance="0.001")  # -> OutPoint, Info, Indexes
xy_plane = XYPlane(Origin=remove_duplicate_points_karamba3d.OutPoint)
beam_loads_karamba3d_2 = BeamLoadsKaramba3D(
    BeamIdentifier=element_karamba3d_2,
    LoadCase="2",
    ForceVector=unit_z,
    TPosition="0.25",
    mode="Concentrated",
    menu=[buttons(off, on)])
beam_loads_karamba3d_3 = BeamLoadsKaramba3D(
    BeamIdentifier=element_karamba3d_3,
    LoadCase="2",
    ForceVector=unit_z_2,
    TStart=0,
    TEnd=1,
    mode="Block",
    menu=[buttons(on, off, off)])
rotate_plane = RotatePlane(Plane=xy_plane, Angle=degrees("90"))
support_karamba3d = SupportKaramba3D(PosInd=remove_duplicate_points_karamba3d.OutPoint, PlaneOfReference=rotate_plane, menu=[buttons(on, on, on, on, on, on)])
element_karamba3d_4 = ElementKaramba3D([line_to_beam_karamba3d.Element, line_to_beam_karamba3d_2.Element, mesh_to_shell_karamba3d_2.Element, mesh_to_shell_karamba3d.Element])
support_karamba3d_2 = SupportKaramba3D(support_karamba3d)
load_karamba3d = LoadKaramba3D(flatten([beam_loads_karamba3d_2, beam_loads_karamba3d_3, loads_karamba3d_2, loads_karamba3d_3, loads_karamba3d, beam_loads_karamba3d]))
element_karamba3d_5 = ElementKaramba3D(flatten(element_karamba3d_4))
load_karamba3d_2 = LoadKaramba3D(flatten(load_karamba3d))
support_karamba3d_3 = SupportKaramba3D(support_karamba3d_2)
assemble_model_karamba3d = AssembleModelKaramba3D(
    Elem=element_karamba3d_5,
    Support=support_karamba3d_3,
    Load=load_karamba3d_2,
    Joint=joint_karamba3d,
    LimitDistance_m=0.005)  # -> Model, Info, Mass_kg, CenterOfGravity, LoadCaseNames
analyze_karamba3d = AnalyzeKaramba3D(Model=assemble_model_karamba3d.Model)  # -> CalculatedModel, MaximumDisplacement_cm, ResultingForceOfGravity_kN, ElasticEnergyChange_kNm
model_view_karamba3d = ModelViewKaramba3D(Model=analyze_karamba3d.CalculatedModel, ResultFactors=1, ResultCase=-1, ElementIdentifiersBreps="&Colonne1")  # -> Model, DeformedMesh, DeformedAxes, DeformedModel
beam_view_karamba3d = BeamViewKaramba3D(Model=model_view_karamba3d.Model)  # -> Model, MeshesOfRenderedBeams, DeformedBeamAxes, LegendColors, LegendTags
