# Grasshopper definition 0_Create.gh (Grasshopper 1.0.7)
# plug-ins: Rhino.Inside for Autodesk Revit

unit_x = UnitX(Factor=1)
basic_wall = ElementTypePicker({"Basic Wall : Wall 1": "6fd16986-88f8-48ca-934f-0df0db84b791:7487a6f9-f026-4d8b-9c25-00897bd0c023-000006f6"}, selected="Basic Wall : Wall 1")
point = Point(Point(0, 0, 0))
line_sdl = LineSDL(Start=point, Direction=unit_x, Length="5000")
levels_picker = LevelsPicker()
wall_location_line = WallLocationLine({"Wall Centerline": 0, "Core Centerline": 1, "Finish (Exterior Face)": 2, "Finish (Interior Face)": 3, "Core (Exterior Face)": 4, "Core (Interior Face)": 5}, selected="Finish (Interior Face)")
curve = Curve(line_sdl)
add_wall_curve = AddWallCurve(Curve=curve, Type=basic_wall, Height="2000", LocationLine=wall_location_line, TrackingMode=2)
inspect_element = InspectElement(Element=add_wall_curve)  # -> ConstraintsRelatedToMass, ConstraintsRoomBounding, ConstraintsBaseConstraint, ConstraintsBaseOffset, ConstraintsBaseExtensionDistance, ConstraintsBaseIsAttached, ConstraintsCrossSection, ConstraintsTopConstraint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
element_type = ElementType()  # -> Element, Type
element_geometry = ElementGeometry(Elements=add_wall_curve)
element_parameter = ElementParameter(Element=add_wall_curve, Parameter="Structural", Value="yes", FailureProcessingMode=1)  # -> Element, Value

count = Count(10)
series = Series(Start=0, Step="1000", Count=count)
construct_point = ConstructPoint(XCoordinate=series, YCoordinate=0, ZCoordinate=0)
unit_y = UnitY(Factor=1)
vector_xyz = VectorXYZ(XComponent="1", YComponent="1", ZComponent=0)  # -> Vector, Length
series_2 = Series(Start=0, Step=1, Count=count)
line_sdl_2 = LineSDL(Start=construct_point, Direction=vector_xyz.Vector, Length="10000")
add_grid = AddGrid(Curve=line_sdl_2, Name=series_2, Type=<elementtype referenced from the Revit model>, TrackingMode=2)
element_geometry_2 = ElementGeometry(Elements=add_grid)

series_3 = Series(Start=0, Step="3000", Count=10)
concatenate = Concatenate(FragmentA="Level_", FragmentB=series_3)
project_elevation = ProjectElevation(Offset=series_3)
add_level = AddLevel(Elevation=project_elevation, Name=concatenate, Type=<elementtype referenced from the Revit model>, TrackingMode=2)
